# Grasshopper definition 凯威特单层网架 11.21.gh (Grasshopper 0.9.75)
# plug-ins: Python Interpreter, SEG, Kangaroo Components

# ---- group: 输入端
径向分段数 = Slider(5, range=1..15)
扇形数量 = Slider(8, range=0..10)
网壳直径 = Slider(32.4, range=0..100)
矢高 = Slider(6.9, range=0..10)

# ----
division = Division(A=网壳直径, B=2)
subtraction = Subtraction(A=矢高, B=division)
pl = PlaneNormal(Origin=Point(0, 0, 0), ZAxis=Vector(0, 0, 1))
sph = Sphere(Base=PlaneXY(0, 0, 0), Radius=division)
pi = Pi(Factor="2")
Z = UnitZ(Factor=subtraction)
division_2 = Division(A=pi, B=扇形数量)
move = Move(Geometry=sph, Motion=Z)  # -> Geometry, Transform
pxs = PlaneThroughShape(Plane=pl, Shape=sph, Inflate=1, SectionLogic=False)
split = SplitBrep(Brep=move.Geometry, Cutter=pxs)
srf = Surface(split)
item = ListItem(List=srf, Index=Slider(0, range=0..1), Wrap=True)
wires = BrepWireframe(Brep=item, Density=-1)
int = Integer(径向分段数)
item_2 = ListItem(List=wires, Index=1, Wrap=True)

# ---- group: 长度判断
曲线长度 = Slider(2.5, range=0..10)
len = Length(Curve=item_2)
panel = Panel(len)
division_3 = Division(A=len, B=曲线长度)
int_2 = Integer(division_3)
addition = Addition(A="1", B=int_2)
最大长度 = Slider(2.5, range=0..10)
最小长度 = Slider(2, range=0..10)
division_4 = Division(A=len, B=addition)
larger = LargerThan(FirstNumber=division_4, SecondNumber=最小长度)  # -> LargerThan, OrEqualTo
smaller = SmallerThan(FirstNumber=division_4, SecondNumber=最大长度)  # -> SmallerThan, OrEqualTo
and = GateAnd(A=larger.OrEqualTo, B=smaller.OrEqualTo)
panel_2 = Panel(and)

# ----
subtraction_2 = Subtraction(A=int, B=1)
divide = DivideCurve(Curve=item_2, Count=int, Kinks=False)  # -> Points, Tangents, Parameters
range = Range(Domain=subtraction_2, Steps=subtraction_2)
devec = DeconstructVector(Vector=divide.Points)  # -> XComponent, YComponent, ZComponent
pt = ConstructPoint(XCoordinate=0, YCoordinate=0, ZCoordinate=devec.ZComponent)
addition_2 = Addition(A=range, B=1)
dom = ConstructDomain(DomainStart=0, DomainEnd=subtraction_2)
arc = Arc(Plane=pt, Radius=devec.XComponent, Angle=division_2)  # -> Arc, Length
item_3 = ListItem(List=pt, Index=int, Wrap=True)
subset = SubList(List=arc.Arc, Domain=dom, Wrap=True)  # -> List, Index
rev = ReverseList(List=subset.List)
pt_2 = Point(item_3)
divide_2 = DivideCurve(Curve=rev, Count=addition_2, Kinks=False)  # -> Points, Tangents, Parameters
combin = Seg_CTree(TreeT1=pt_2, TreeT2=divide_2.Points)
rev_2 = ReverseList(List=combin)
flip = FlipMatrix(Data=combin)
flip_2 = FlipMatrix(Data=rev_2)
clean = CleanTree(Tree=flip, CleanInvalid=True, CleanEmpty=False)
clean_2 = CleanTree(Tree=flip_2, CleanInvalid=True, CleanEmpty=False)
连线 = PythonScript(inPts=clean_2)  # -> out, outLines; inputs inPts: list of Point3d
# ---------- 连线: Python ----------
#coding = utf-8

import rhinoscriptsyntax as rs

listLength = len(inPts)
lines = []

for index in range(0, listLength-1):
    lines.append(rs.AddLine(inPts[index],inPts[index+1]))

outLines = lines
# ---------- end 连线 ----------
连线_2 = PythonScript(inPts=combin)  # -> out, outLines; inputs inPts: list of Point3d; same code as 连线
连线_3 = PythonScript(inPts=clean)  # -> out, outLines; inputs inPts: list of Point3d; same code as 连线
merge = Merge(Data1=连线_2.outLines, Data2=连线_3.outLines, Data3=连线.outLines)
arrpolar = PolarArray(Geometry=merge, Plane=PlaneXY(0, 0, 0), Count=扇形数量, Angle=6.283185307)  # -> Geometry, Transform
dupln = RemoveDuplicateLines(Lines=flatten(arrpolar.Geometry), Tolerance=0.01)
crv = Curve(dupln)
sort = SortList(Keys=flatten(crv), ValuesA=flatten(crv))  # -> Keys, ValuesA
pipe = Pipe(Curve=crv, Radius=Slider(0.1, range=0..0.1), Caps=0)
panel_3 = Panel(sort.Keys)
